# Grasshopper definition extract_control_polygons.gh (Grasshopper 1.0.7)

crv = Curve([<curve referenced from the Rhino model> x7])
explode = Explode(Curve=crv, Recursive=True)  # -> Segments, Vertices
cp = ControlPoints(Curve=simplify(explode.Segments))  # -> Points, Weights, Knots
int = Integer(1000)
pdecon = Deconstruct(Point=cp.Points)  # -> XComponent, YComponent, ZComponent
multiplication = Multiplication(A=pdecon.XComponent, B=int)
multiplication_2 = Multiplication(A=pdecon.YComponent, B=int)
round = Round(Number=multiplication)  # -> Nearest, Floor, Ceiling
round_2 = Round(Number=multiplication_2)  # -> Nearest, Floor, Ceiling
division = Division(A=round.Nearest, B=int)
division_2 = Division(A=round_2.Nearest, B=int)
pt = ConstructPoint(XCoordinate=division, YCoordinate=division_2, ZCoordinate=0)
format = Format(Format="[{0}, {1}]", Culture=127, Data0=division, Data1=division_2)
join = TextJoin(Text=format, Join=", ")
format_2 = Format(Format="[{0}]", Culture=127, Data0=join)
pshift = ShiftPaths(Data=format_2, Offset=-1)
join_2 = TextJoin(Text=pshift, Join=", ")
format_3 = Format(Format="[{0}]", Culture=127, Data0=join_2)  # -> flatten(Text)
join_3 = TextJoin(Text=format_3, Join=", ")
format_4 = Format(Format="[{0}]", Culture=127, Data0=join_3)
panel = Panel(format_4)
