# Grasshopper definition noword.gh (Grasshopper 1.0.7)

crv = Curve([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])
srf = Surface([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])
project = Project(Curve=crv, Brep=graft(srf), Direction=Vector(0, 0, 1))
clean = CleanTree(RemoveNulls=True, RemoveInvalid=True, RemoveEmpty=True, Tree=project)  # -> simplify(Tree)
tstat = TreeStatistics(Tree=clean)  # -> Paths, Length, Count
X = UnitX(Factor=5)
random = Random(Range=Domain(-1, 1), Number=2, Seed=2)  # -> simplify(Random)
move = Move(Geometry=clean, Motion=X)  # -> Geometry, Transform
vec = Vector(Vector(1.60939713, 2.927505847, 0))
repeat = RepeatData(Data=random, Length=tstat.Count)  # -> graft(Data)
multiplication = Multiplication(A=repeat, B=Slider(0.084, range=0..1))
multiplication_2 = Multiplication(A=vec, B=multiplication)
move_2 = Move(Geometry=move.Geometry, Motion=multiplication_2)  # -> Geometry, Transform
